# Grasshopper definition test01.gh (Grasshopper 1.0.7)

file_path = FilePath("D:\test.py")
read_file = ReadFile(File=file_path, PerLineParse=False)  # -> Content
#   port File: Uri of file to read
# ---------- read_file: VB line parser ----------
    action = GH_LineParserAction.Include
    Return line

    'Parse the line and return some data that represents the line.
    'If the line cannot be parsed, you can return Nothing and
    'assign a different action.
    'The default implementation is to just return the line itself.
    'If you return types that implement IGH_Goo, this component
    'will work substantially faster.
# ---------- end read_file ----------
ghpython_script = GhPythonScript(Code=read_file)  # -> Out, Result, A, B, C
panel = Panel(ghpython_script.Result)
panel_2 = Panel(ghpython_script.Out)
