# Grasshopper definition test03.gh (Grasshopper 1.0.7)

ghpython_script = GhPythonScript()  # -> out, a
# ---------- ghpython_script: Python ----------
__author__ = "veoer"
__version__ = "2025.04.03"

import Rhino.Geometry as rg
import ghpythonlib.components as ghcomp
import math

# Parameters
count = 10          # Number of circles
min_radius = 5.0    # Radius of the smallest circle
max_radius = 50.0   # Radius of the largest circle
spacing = 15.0      # Spacing between circle centers

# Lists to store our results
circles = []
center_points = []

# Calculate radius increment
radius_step = (max_radius - min_radius) / (count - 1)

# Create circles from small to big
for i in range(count):
    # Calculate current radius
    current_radius = min_radius + (radius_step * i)
    
    # Calculate current position (arranged in a line along X-axis)
    current_x = i * spacing
    center = rg.Point3d(current_x, 0, 0)
    
    # Create circle using ghcomp
    circle = ghcomp.Circle(rg.Plane(center, rg.Vector3d.ZAxis), current_radius)
    
    # Add to our lists
    circles.append(circle)
    center_points.append(center)

# Output
a = circles        # Output the circles
b = center_points  # Output the center points (optional)
# ---------- end ghpython_script ----------
addition = Addition()
ghpython_script_2 = GhPythonScript()  # -> out, a
# ---------- ghpython_script_2: Python ----------
__author__ = "veoer"
__version__ = "2025.04.03"

import rhinoscriptsyntax as rs
import Rhino.Geometry as rg

# Create a circle with 50mm radius at the origin
center = rg.Point3d(0, 0, 0)
circle = rg.Circle(rg.Plane.WorldXY, center, 50)

# Output the circle to Grasshopper
a = circle
# ---------- end ghpython_script_2 ----------
ghpython_script_3 = GhPythonScript()  # -> out, a
# ---------- ghpython_script_3: Python ----------
__author__ = "veoer"
__version__ = "2025.04.03"

import rhinoscriptsyntax as rs
import Rhino
import Grasshopper
from Grasshopper.Kernel import GH_ComponentServer

# Access the current Grasshopper document
gh_doc = Grasshopper.Instances.ActiveCanvas.Document

# Find the component by name and type
server = GH_ComponentServer.FindServer(component_name, component_type)
if server is None:
    raise ValueError(f"Component '{component_name}' of type '{component_type}' not found")

# Create the component instance
component = server.Create()
component.ComponentGuid = System.Guid(component_id)

# Set parameters
for param_name, param_value in parameters.items():
    if hasattr(component, param_name):
        setattr(component, param_name, param_value)

# Add the component to the document
gh_doc.AddObject(component, False)

# Set the position on canvas
component.Attributes.Pivot = Grasshopper.Kernel.GH_Convert.ToPoint(
    Rhino.Geometry.Point2d(gh_doc.Bounds.Center.X, gh_doc.Bounds.Center.Y)
)

# Update the document
gh_doc.NewSolution(True)

# Return component info
result = {
    "component_id": str(component_id)
}
"""
# ---------- end ghpython_script_3 ----------
